% Simulink data dictionary XPSbW_PublicDataType.sldd

SbWHlthStEnum = enum(DataScope="Exported", HeaderFile="XPSbW_PublicDataType.h", DefaultValue="Normal", StorageType="uint8", AddClassNameToEnumNames=true)
  Normal = 0
  T_N_1 = 1
  Deg1 = 2
  T_X_2_A = 3
  T_X_2_B = 4
  T_X_2_C = 5
  Deg2 = 6
  T_X_3 = 7
  T_2_3 = 8
  Deg3 = 9
  T_X_Emgy = 10
  Init = 11

HWASysStEnum = enum(DataScope="Exported", HeaderFile="XPSbW_PublicDataType.h", DefaultValue="Error", StorageType="uint8", AddClassNameToEnumNames=true)
  Error = 0
  Off = 1
  DriveUp = 2
  DriveDown = 3
  PreDrive = 4
  PostRun = 5
  Init = 6

HWAStrWhlAgIvsStsEnum = enum(DataScope="Exported", HeaderFile="XPSbW_PublicDataType.h", DefaultValue="Invalid", StorageType="uint8", AddClassNameToEnumNames=true)
  Invalid = 0
  Normal = 1
  OutOfRange = 2

FaultMngtStsEnum = enum(DataScope="Exported", HeaderFile="XPSbW_PublicDataType.h", DefaultValue="FaultPassed", StorageType="uint8", AddClassNameToEnumNames=true)
  FaultPassed = 0
  FaultFailed = 1
  FaultPrePassed = 2
  FaultPreFailed = 3

RWAMSSwiMod = enum(DataScope="Exported", HeaderFile="XPSbW_PublicDataType.h", DefaultValue="init", StorageType="uint8", AddClassNameToEnumNames=true)
  init = 0
  off = 1
  dom = 2
  listen = 3
  runalone = 4

VMCSTCModeEnum = enum(DataScope="Exported", HeaderFile="XPSbW_PublicDataType.h", DefaultValue="Init", StorageType="uint8", AddClassNameToEnumNames=true)
  Init = 0
  Tq = 1
  TqOfst = 2
  AxisAg = 3
  AxisAgOfst = 4
  CornrAg = 5
  CornrAgOfst = 6

RWASysStEnum = enum(DataScope="Exported", HeaderFile="XPSbW_PublicDataType.h", DefaultValue="Error", StorageType="uint8", AddClassNameToEnumNames=true)
  Error = 0
  Off = 1
  DriveUp = 2
  DriveDown = 3
  PreDrive = 4
  PostRun = 5
  Init = 6

PwrModEnum = enum(DataScope="Exported", HeaderFile="XPSbW_PublicDataType.h", DefaultValue="Off", StorageType="uint8", AddClassNameToEnumNames=true)
  Off = 0
  LocalOn = 1
  RemoteOn = 2

HiVltgStEnum = enum(DataScope="Exported", HeaderFile="XPSbW_PublicDataType.h", DefaultValue="NotReady", StorageType="uint8", AddClassNameToEnumNames=true)
  NotReady = 0
  HiVltgOn = 1
  Ready = 2

GearLvlEnum = enum(DataScope="Exported", HeaderFile="XPSbW_PublicDataType.h", DefaultValue="Invalid", StorageType="uint8", AddClassNameToEnumNames=true)
  Invalid = 0
  D = 1
  N = 2
  R = 3
  P = 4

SysFaultLevelEnum = enum(DataScope="Exported", HeaderFile="XPSbW_PublicDataType.h", DefaultValue="F0", StorageType="uint8", AddClassNameToEnumNames=true)
  F0 = 0
  F1 = 1
  F2 = 2
  F3 = 3

DMSCFactorModEnum = enum(DataScope="Exported", HeaderFile="XPSbW_PublicDataType.h", DefaultValue="ConstantMode", StorageType="uint8", AddClassNameToEnumNames=true)
  ConstantMode = 0
  CustomCFactorMode = 1
  VariableMode = 2
  Mode2 = 3

DMSSteerFeelModEnum = enum(DataScope="Exported", HeaderFile="XPSbW_PublicDataType.h", DefaultValue="NotUsed", StorageType="uint8", AddClassNameToEnumNames=true)
  NotUsed = 0
  Standard = 1
  Comfort = 2
  Sport = 3
  Geeker = 4

FaultMngtParaEnum = enum(DataScope="Exported", HeaderFile="XPSbW_PublicDataType.h", DefaultValue="ParaBit0", StorageType="uint8", AddClassNameToEnumNames=true)
  ParaBit0 = 0
  ParaBit1 = 1
  ParaBit2 = 2
  ParaBit3 = 3
  ParaBit4 = 4
  ParaBit5 = 5
  ParaBit6 = 6
  ParaBit7 = 7

HWAFctModEnum = enum(DataScope="Exported", HeaderFile="XPSbW_PublicDataType.h", DefaultValue="NormalDriving", StorageType="uint8", AddClassNameToEnumNames=true)
  NormalDriving = 0
  AlignmentMode = 1
  InEgress = 2
  GameMode = 3
  RestMode = 4
  SilentMode = 5
  Ready = 6
  MinorStrMode = 7
  Init = 8

DMSCurrCharcEnum = enum(DataScope="Exported", HeaderFile="XPSbW_PublicDataType.h", DefaultValue="NormConStd", StorageType="uint8", AddClassNameToEnumNames=true)
  NormConStd = 0
  NormConCmft = 1
  NormConSpt = 2
  NormVariStd = 3
  NormVariCmft = 4
  NormVariSpt = 5
  NormVariGkr = 6
  L2APACon = 7
  L2APAVari = 8
  L2AESCon = 9
  L2AESVari = 10
  L2LCCCon = 11
  L2LCCVari = 12
  L4APACon = 13
  L4APAVari = 14
  L4AESCon = 15
  L4AESVari = 16
  L4LCCCon = 17
  L4LCCVari = 18
  GameMode = 19

HWALaneStEnum = enum(DataScope="Exported", HeaderFile="XPSbW_PublicDataType.h", DefaultValue="dom", StorageType="uint8", AddClassNameToEnumNames=true)
  dom = 0
  listen = 1
  reserved1 = 2
  reserved2 = 3

FctCoorrChIDEnum = enum(DataScope="Exported", HeaderFile="XPSbW_PublicDataType.h", DefaultValue="SoftEndStop", StorageType="uint8", AddClassNameToEnumNames=true)
  SoftEndStop = 0
  ActvDampg = 1
  ActvRtn = 2
  FricCmp = 3
  BasAssi = 4
  RoadFb = 5
  CatchUp = 6
  InEGress = 7
  Sync = 8
  GameMode = 9
  GameModeVib = 10
  TbTHiFreqCmp = 11
  InertiaCmp = 12
  L2ADMode = 13
  L4ADMode = 14
  LDW = 15
  VMCMode = 16

CAN_FD_MESSAGE_BUS = Simulink.Bus()
  ProtocolMode: uint8
  Extended: uint8
  Length: uint8
  Remote: uint8
  Error: uint8
  BRS: uint8
  ESI: uint8
  DLC: uint8
  ID: uint32
  Reserved: uint32
  Timestamp: double
  Data: uint8[64]

MotCtrlModeEnum = enum(DataScope="Exported", HeaderFile="XPSbW_PublicDataType.h", DefaultValue="CurrMod", StorageType="uint8", AddClassNameToEnumNames=true)
  Invalid = 0
  CurrMod = 1
  VoltMod = 2
  VelMod = 3
  PosMod = 4
  ZeroTqMod = 5
  ASCMod = 6
  SPOMod = 7

VMCEndCtrlRsnEnum = enum(DataScope="Exported", HeaderFile="XPSbW_PublicDataType.h", DefaultValue="Normal", StorageType="uint8", AddClassNameToEnumNames=true)
  Normal = 0
  AbNmlCANIn = 1
  AgReqOverRng = 2
  AgReqVelOverRang = 3
  Failure = 4
  DrvrInt = 5
  VMCNotCfgd = 6
  MotTqOverRng = 7
  ExeXPUReq = 8
  TqReqGradOverRng = 9

VMCCtrlModeEnum = enum(DataScope="Exported", HeaderFile="XPSbW_PublicDataType.h", DefaultValue="None", StorageType="uint8", AddClassNameToEnumNames=true)
  None = 0
  AES = 1
  USOS = 2
  RDC = 3
  ADC = 4
  BOC = 5
  RRC = 6

VMCCtrlStEnum = enum(DataScope="Exported", HeaderFile="XPSbW_PublicDataType.h", DefaultValue="NoReq", StorageType="uint8", AddClassNameToEnumNames=true)
  NoReq = 0
  Available = 1
  ReqHonored = 2
  CtrlReqNotAllowed = 3

L2CtrlModeEnum = enum(DataScope="Exported", HeaderFile="XPSbW_PublicDataType.h", DefaultValue="Init", StorageType="uint8", AddClassNameToEnumNames=true)
  Init = 0
  APA = 1
  RPA = 2
  LCC = 3
  ELK = 4
  AES = 5
  Resevered = 6
  enum8 = 7

L4CtrlModeEnum = enum(DataScope="Exported", HeaderFile="XPSbW_PublicDataType.h", DefaultValue="None", StorageType="uint8", AddClassNameToEnumNames=true)
  None = 0
  L4_AVP = 1
  L4_Comfort = 2
  L4_Emergency = 3
  Reserved = 4
  Reserved1 = 5
  Reserved2 = 6
  Reserved3 = 7

AlignmentStEnum = enum(DataScope="Exported", HeaderFile="XPSbW_PublicDataType.h", DefaultValue="AlignNotNeeded", StorageType="uint8", AddClassNameToEnumNames=true)
  AlignNotNeeded = 0
  WaitingToBeAligned = 1
  HWAtoRWA = 2
  RWAtoHWA = 3
  Completed = 4
  Fail = 5
  PreconditionsNotFulfilled = 6
  ByPassed = 7
  ForceAlignFailed = 8

MotCtrlMngtAdc1IfStruct = Simulink.Bus(DataScope="Exported", HeaderFile="XPSbW_MotCtrlDMAPublicDataType.h")
  ControllerKL30Vltg: single
  MotNtcTemp1Mos1: single
  MotNtcTemp1Mos2: single
  MotNtcTemp1Mos3: single

MotCtrlMngtAdc2IfStruct = Simulink.Bus(DataScope="Exported", HeaderFile="XPSbW_MotCtrlDMAPublicDataType.h")
  PhyValue_MotCurrAMeas_mV: single
  PhyValue_MotCurrBMeas_mV: single
  PhyValue_MotCurrCMeas_mV: single
  PhyValue_MotAnAgSinNRaw_mV: single
  PhyValue_MotAnAgSinPRaw_mV: single
  PhyValue_MotAnAgCosNRaw_mV: single
  PhyValue_MotAnAgCosPRaw_mV: single

MotCtrlMngtIRQ2RteIfStruct = Simulink.Bus(DataScope="Exported", HeaderFile="XPSbW_MotCtrlDMAPublicDataType.h")
  ES003_f32_MotAgArbd_deg: single
  ES006_f32_MotCurrDAxis_A: single
  ES006_f32_MotCurrQAxis_A: single

MotCtrlMngtRTE2IRQIfStruct = Simulink.Bus(DataScope="Exported", HeaderFile="XPSbW_MotCtrlDMAPublicDataType.h")
  ES004_f32_MotVelElecFild_radps: single
  ES008_f32_MotBrdgVltg_V: single
  MF001_f32_MotKeEstimn_Vpradps: single
  MF001_f32_MotQAxisInduEstimn_Henry: single
  MF001_f32_MotDAxisInduEstimn_Henry: single
  MF001_f32_MotREstimn_Ohm: single
  MF002_f32_MotCurrLoopDAxisKi_UL: single
  MF002_f32_MotCurrLoopDAxisKp_UL: single
  MF002_f32_MotCurrLoopQAxisKi_UL: single
  MF002_f32_MotCurrLoopQAxisKp_UL: single
  MF014_f32_MotVFCtrlVltgAlpha_V: single
  MF014_f32_MotVFCtrlVltgBeta_V: single
  MF014_u8_MotCtrlMode_UL: uint8
  ES008_f32_MotCurrVROMeas_V: single
  MF005_f32_MotCurrDAxisCmd_A: single
  MF005_f32_MotCurrQAxisCmd_A: single

MotCtrlIRQIfStruct = Simulink.Bus(DataScope="Exported", HeaderFile="XPSbW_MotCtrlDMAPublicDataType.h")
  ES013_f32_MotAnAgPSin_UL: single
  ES013_f32_MotAnAgPCos_UL: single
  ES013_f32_MotAnAgNSin_UL: single
  ES013_f32_MotAnAgNCos_UL: single
  ES014_f32_MotAnAg_deg: single
  ES003_f32_MotAgArbd_deg: single
  ES005_f32_MotCurrAMeasArbt_A: single
  ES005_f32_MotCurrBMeasArbt_A: single
  ES005_f32_MotCurrCMeasArbt_A: single
  ES005_b_CurrSenseErrorFlag_flg: boolean
  ES006_f32_MotCurrDAxis_A: single
  ES006_f32_MotCurrQAxis_A: single
  MF006_f32_MotCtrlVltgDAxisCmd_V: single
  MF006_f32_MotCtrlVltgQAxisCmd_V: single
  MF007_f32_MotCtrPwmAPha_UL: single
  MF007_f32_MotCtrPwmBPha_UL: single
  MF007_f32_MotCtrPwmCPha_UL: single
  MF007_u8_MotAgCalibrationSt_st_gdu8: uint8
  MF007_f32_PreMotZeroPosOffset_deg_gdf32: single
  ES014_u8_MotAgChannel_UL: uint8

AligFailRsnEnum = enum(DataScope="Exported", HeaderFile="XPSbW_PublicDataType.h", DefaultValue="NoFlt", StorageType="uint8", AddClassNameToEnumNames=true)
  NoFlt = 0
  ColPosStack = 1
  CANSigFlt = 2
  HWARWAAgInvld = 4
  AlignTmOverRng = 8
  SysFlt = 16