% Simulink data dictionary XPSbW_PublicDma.sldd
% references XPSbW_PublicDataType.sldd

MotCtrlMngtAdc1If = XpengPackage.Signal(DoubleProperty=0, Int32Property=int32(0), LogicalProperty=false, OnOffCharProperty="off", ColorCharProperty="red", StorageClass="MyMonitor", HeaderFile="XPSbW_MotCtrlDMAPublicData.h", DefinitionFile="XPSbW_MotCtrlDMAPublicData.c", DataType="Bus: MotCtrlMngtAdc1IfStruct")
MotCtrlMngtAdc2If = XpengPackage.Signal(DoubleProperty=0, Int32Property=int32(0), LogicalProperty=false, OnOffCharProperty="off", ColorCharProperty="red", StorageClass="MyMonitor", HeaderFile="XPSbW_MotCtrlDMAPublicData.h", DefinitionFile="XPSbW_MotCtrlDMAPublicData.c", DataType="Bus: MotCtrlMngtAdc2IfStruct")
MotCtrlMngtRTE2IRQIf = XpengPackage.Signal(DoubleProperty=0, Int32Property=int32(0), LogicalProperty=false, OnOffCharProperty="off", ColorCharProperty="red", StorageClass="MyMonitor", HeaderFile="XPSbW_MotCtrlDMAPublicData.h", DefinitionFile="XPSbW_MotCtrlDMAPublicData.c", DataType="Bus: MotCtrlMngtRTE2IRQIfStruct")
MotCtrlMngtRTE2IRQReadIf = XpengPackage.Signal(DoubleProperty=0, Int32Property=int32(0), LogicalProperty=false, OnOffCharProperty="off", ColorCharProperty="red", StorageClass="MyMonitor", HeaderFile="XPSbW_MotCtrlDMAPublicData.h", DefinitionFile="XPSbW_MotCtrlDMAPublicData.c", DataType="Bus: MotCtrlMngtRTE2IRQIfStruct")
MotCtrlMngtIRQ2RTEIf = XpengPackage.Signal(DoubleProperty=0, Int32Property=int32(0), LogicalProperty=false, OnOffCharProperty="off", ColorCharProperty="red", StorageClass="MyMonitor", HeaderFile="XPSbW_MotCtrlDMAPublicData.h", DefinitionFile="XPSbW_MotCtrlDMAPublicData.c", DataType="Bus: MotCtrlMngtIRQ2RteIfStruct")
MotCtrlMngtIRQ2RTEWriteIf = XpengPackage.Signal(DoubleProperty=0, Int32Property=int32(0), LogicalProperty=false, OnOffCharProperty="off", ColorCharProperty="red", StorageClass="MyMonitor", HeaderFile="XPSbW_MotCtrlDMAPublicData.h", DefinitionFile="XPSbW_MotCtrlDMAPublicData.c", DataType="Bus: MotCtrlMngtIRQ2RteIfStruct")
MotCtrlIRQIf = XpengPackage.Signal(DoubleProperty=0, Int32Property=int32(0), LogicalProperty=false, OnOffCharProperty="off", ColorCharProperty="red", StorageClass="MyMonitor", HeaderFile="XPSbW_MotCtrlDMAPublicData.h", DefinitionFile="XPSbW_MotCtrlDMAPublicData.c", DataType="Bus: MotCtrlIRQIfStruct")