% Simulink data dictionary SF020_SysFaultMngtProxy_Local.sldd

CalC_SF020_f32_FaultDegFactorGain_UL = XpengPackage.Parameter(250, DoubleProperty=0, Int32Property=int32(0), LogicalProperty=false, OnOffCharProperty="off", ColorCharProperty="red", StorageClass="MyCalib", DataType="single")
Monr_SF020_f32_SysFaultDegFactor_UL = XpengPackage.Signal(DoubleProperty=0, Int32Property=int32(0), LogicalProperty=false, OnOffCharProperty="off", ColorCharProperty="red", StorageClass="MyMonitor", DataType="single")
Monr_SF020_u8_SysFaultProxyPara_UL = XpengPackage.Signal(DoubleProperty=0, Int32Property=int32(0), LogicalProperty=false, OnOffCharProperty="off", ColorCharProperty="red", StorageClass="MyMonitor", DataType="uint8")
Monr_SF020_u8_SysFaultStatus_UL = XpengPackage.Signal(DoubleProperty=0, Int32Property=int32(0), LogicalProperty=false, OnOffCharProperty="off", ColorCharProperty="red", StorageClass="MyMonitor", DataType="uint8", Dimensions=[32 1])
Monr_SF020_u8_SysFaultType_UL = XpengPackage.Signal(DoubleProperty=0, Int32Property=int32(0), LogicalProperty=false, OnOffCharProperty="off", ColorCharProperty="red", StorageClass="MyMonitor", DataType="uint8")